# Grasshopper definition analysis-fourier-loft.gh (Grasshopper 1.0.8)
# plug-ins: Swalloop

# about: Fourier: simplify the loft
# 
# Low-pass the result of the loop two ways: the floor-by-floor width profile (four harmonics describe the whole taper, which is what a panel layout needs) and the outline of the top floor (fewer harmonics, a simpler outline to build). Try Rotation in the Floor profile node: it has a step where the optimiser flips orientation, and a low-pass rings there (the Gibbs effect).
ctx = Context(Style="Manhattan", Blocks=3, HeightScale=1, Seed=7)
tower = Tower(Floors=60, FloorHeight=4, Width=36, Depth=36, TwistDeg=0, Roundness=0.2, Source="Initial")
start = LoopStart(Initial=tower)  # -> State, Index, Item
wind = Wind(Tower=start.State, Context=ctx, Speed10mMS=40, FromDeg=300, TerrainExp=0.25)
stream = Orient(
    Tower=wind,
    Rate=0.2,
    Aspect=1.8,
    MaxRoundness=0.8,
    SunWeight=0.7,
    SunAzimuth=150,
    MinWidthM=0,
    MinDepthM=0,
    MinCornerRadiusM=0,
    MaxRotationPassDeg=90,
    MaxTwistFromBaseDeg=0,
    FloorToFloorSmoothing=0,
    Search="Grid")
struct = Structure(Tower=stream, AllowableMPa=6, FloorLoadKNM2=10, StructuralShare=0.08, Relaxation=0.3, MinPlateM=20, MaxPlateM=60)
end = LoopEnd(Result=struct, Kind="Repeat", Iterations=150, Tolerance=0.01)  # -> Result, History, Iterations, LastChange
prof = FloorProfile(Tower=end.Result, Quantity="Width")  # -> Values, HeightsM
four = FourierSmooth(Signal=prof.Values, HarmonicsKept=4, Ends="Mirror")  # -> Smoothed, Amplitudes, EnergyKept
both = Collect(A=prof.Values, B=four.Smoothed)
loft = Inspector(Value=both, Spacing=4)  # -> Value, Geometry
out = FloorOutline(Tower=end.Result, Floor=999)
fc = FourierOutline(Outline=out, HarmonicsKept=3)  # -> Simplified, MaxDeviationM, AreaKept, EnergyKept
rings = Collect(A=out, B=fc.Simplified)
outlines = Inspector(Value=rings, Spacing=4)  # -> Value, Geometry
r1 = Panel(four.EnergyKept)
r2 = Panel(fc.MaxDeviationM)
r3 = Panel(fc.AreaKept)
