# Grasshopper definition analysis-log-wind.gh (Grasshopper 1.0.8)
# plug-ins: Swalloop

# about: Log wind profile
# 
# The logarithmic wind profile for a terrain roughness, turned into a pressure profile and integrated: base shear and overturning moment per metre of width, and the power-law exponent that matches this terrain.
z = Range(Count=30, Start=10, Step=10)
rough = Slider(1, range=0.01..3)
vref = Slider(40, range=10..60)
log = LogWindProfile(HeightsM=z, SpeedAtRefMS=vref, RefHeightM=10, RoughnessZ0M=rough)  # -> SpeedMS, PowerLawExponent
sq = ListMath(A=log.SpeedMS, B=log.SpeedMS, Op="×", SWhenNoB=1)
q = ListMath(A=sq, Op="×", SWhenNoB=0.0006125)
shear = Integrate(Y=q, X=z, Method="Simpson", Integrand="f", XStart=0, DxNoX=1)  # -> Integral, Cumulative
mom = Integrate(Y=q, X=z, Method="Simpson", Integrand="x·f", XStart=0, DxNoX=1)  # -> Integral, Cumulative
speeds = Inspector(Value=log.SpeedMS, Spacing=4)  # -> Value, Geometry
pressure = Inspector(Value=q, Spacing=4)  # -> Value, Geometry
r1 = Panel(log.PowerLawExponent)
r2 = Panel(shear.Integral)
r3 = Panel(mom.Integral)
