# Grasshopper definition analysis-matrix-twist.gh (Grasshopper 1.0.8)
# plug-ins: Swalloop

# about: Matrix powers: twisting tower
# 
# One 3x3 matrix (turn a little, shrink a little) applied floor after floor: floor i is the base outline times M to the power i. A For each loop builds every outline; the principal axes of the top outline read back the twist.
base = Polygon(Sides=6, RadiusM=24, AspectYX=1.6, RotateDeg=0)
turn = Slider(3, range=-10..10)
shrink = Slider(0.985, range=0.9..1.02)
m = AffineMatrix(RotateDeg=turn, ScaleX=shrink, ScaleY=shrink, MoveX=0, MoveY=0, PivotX=0, PivotY=0)
floors = Range(Count=30, Start=0, Step=1)
start = LoopStart()  # -> State, Index, Item
mp = MatrixPower(M=m, K=start.Item)
ap = ApplyMatrix(Matrix=mp, Points=base)
end = LoopEnd(Result=ap, Items=floors, Kind="For each", Iterations=150, Tolerance=0.002)  # -> Result, History, Iterations, LastChange
view = Inspector(Value=end.Result, Spacing=4)  # -> Value, Geometry
top = MatrixPower(M=m, K=29)
toppts = ApplyMatrix(Matrix=top, Points=base)
axes = PrincipalAxes(Points=toppts)  # -> MainAxisDeg, SpreadAlongM, SpreadAcrossM, Elongation, CentreX, CentreY
r1 = Panel(axes.MainAxisDeg)
r2 = Panel(axes.Elongation)
