# Grasshopper definition analysis-splat-shelter.gh (Grasshopper 1.0.8)
# plug-ins: Swalloop

# about: Gaussian splats: shelter map
# 
# Every neighbouring building becomes a 2D Gaussian splat. Added up they are a density map of where the block is tall (shelter and shade); composited front to back by height they are the splat render of the block, the same blending rule as 3D Gaussian splatting.
ctx = Context(Style="Manhattan", Blocks=3, HeightScale=1, Seed=7)
spl = ContextSplats(Context=ctx, FullOpacityAtM=150)
add = GaussianSplatField(Splats=spl, GridSize=56, HalfExtentM=260, Blend="Additive", Gain=1)  # -> Field, Max, Total
comp = GaussianSplatField(Splats=spl, GridSize=56, HalfExtentM=260, Blend="Composite", Gain=1)  # -> Field, Max, Total
shelter = Inspector(Value=add.Field, Spacing=4)  # -> Value, Geometry
render = Inspector(Value=comp.Field, Spacing=4)  # -> Value, Geometry
r1 = Panel(add.Max)
r2 = Panel(comp.Max)
