# Grasshopper definition analysis-tower-log-wind.gh (Grasshopper 1.0.8)
# plug-ins: Swalloop

# about: Tower in log-law wind
# 
# The Manhattan loop with its wind exponent computed from the logarithmic profile of the terrain roughness, instead of typed in. Change the roughness and the whole form follows.
ctx = Context(Style="Manhattan", Blocks=3, HeightScale=1, Seed=7)
tower = Tower(Floors=60, FloorHeight=4, Width=36, Depth=36, TwistDeg=0, Roundness=0.2, Source="Initial")
start = LoopStart(Initial=tower)  # -> State, Index, Item
z = Range(Count=30, Start=10, Step=10)
rough = Slider(1, range=0.01..3)
log = LogWindProfile(HeightsM=z, SpeedAtRefMS=40, RefHeightM=10, RoughnessZ0M=rough)  # -> SpeedMS, PowerLawExponent
wind = Wind(Tower=start.State, Context=ctx, Speed10mMS=40, FromDeg=300, TerrainExp=log.PowerLawExponent)
stream = Orient(
    Tower=wind,
    Rate=0.2,
    Aspect=1.8,
    MaxRoundness=0.8,
    SunWeight=0.7,
    SunAzimuth=150,
    MinWidthM=0,
    MinDepthM=0,
    MinCornerRadiusM=0,
    MaxRotationPassDeg=90,
    MaxTwistFromBaseDeg=0,
    FloorToFloorSmoothing=0,
    Search="Grid")
struct = Structure(Tower=stream, AllowableMPa=6, FloorLoadKNM2=10, StructuralShare=0.08, Relaxation=0.3, MinPlateM=20, MaxPlateM=60)
end = LoopEnd(Result=struct, Kind="Repeat", Iterations=150, Tolerance=0.01)  # -> Result, History, Iterations, LastChange
sun = Sun(Tower=end.Result, Context=ctx, AzimuthDeg=150, AltitudeDeg=35)
metrics = Metrics(Tower=end.Result)  # -> FloorAreaM2, StructureM3, BaseMomentMNm, MaxUtilisation
view = Viewer(
    Tower=sun,
    Context=ctx,
    History=end.History,
    ColourBy="Utilisation",
    Colormap="Turbo",
    Range="Auto",
    Min=0,
    Max=1,
    Reverse="No")  # -> Tower, Floors, Context
r1 = Panel(log.PowerLawExponent)
r2 = Panel(metrics.BaseMomentMNm)
r3 = Panel(metrics.FloorAreaM2)
