# Grasshopper definition loops-fold.gh (Grasshopper 1.0.8)
# plug-ins: Swalloop

# about: Demo: Fold (running sum of 1..10)
# 
# A Fold: walks a list and carries a running total through each item.
items = Range(Count=10, Start=1, Step=1)
x0 = Slider(0, range=0..10)
start = LoopStart(Initial=x0)  # -> State, Index, Item
add = Math(Op="+", A=start.State, B=start.Item)
end = LoopEnd(Result=add, Items=items, Kind="Fold", Iterations=150, Tolerance=0.002)  # -> Result, History, Iterations, LastChange
view = Inspector(Value=end.Result, History=end.History, Spacing=4)  # -> Value, Geometry
