# Grasshopper definition loops-for-each.gh (Grasshopper 1.0.8)
# plug-ins: Swalloop

# about: Demo: For each (squares of 1..8)
# 
# A For each: the body runs once per item, independently, and returns the list of results.
items = Range(Count=8, Start=1, Step=1)
start = LoopStart()  # -> State, Index, Item
sq = Math(Op="×", A=start.Item, B=start.Item)
end = LoopEnd(Result=sq, Items=items, Kind="For each", Iterations=150, Tolerance=0.002)  # -> Result, History, Iterations, LastChange
view = Inspector(Value=end.Result, History=end.History, Spacing=4)  # -> Value, Geometry
