# Grasshopper definition loops-logistic.gh (Grasshopper 1.0.8)
# plug-ins: Swalloop

# about: Demo: logistic map
# 
# The logistic map: the same loop, a different behaviour (settling, cycling, chaos).
x0 = Slider(0.2, range=0..1)
r = Slider(3.7, range=0..4)
start = LoopStart(Initial=x0)  # -> State, Index, Item
step = LogisticMap(X=start.State, R=r)
end = LoopEnd(Result=step, Kind="Repeat", Iterations=120, Tolerance=0)  # -> Result, History, Iterations, LastChange
view = Inspector(Value=end.Result, History=end.History, Spacing=4)  # -> Value, Geometry
