# Grasshopper definition loops-newton.gh (Grasshopper 1.0.8)
# plug-ins: Swalloop

# about: Demo: Newton square root
# 
# A number iterates toward the square root of another: the loop on plain numbers, no geometry.
x0 = Slider(1, range=0.1..10)
a = Slider(2, range=0.5..50)
start = LoopStart(Initial=x0)  # -> State, Index, Item
step = NewtonStep(X=start.State, SqrtOf=a)
end = LoopEnd(Result=step, Kind="Repeat", Iterations=20, Tolerance=0)  # -> Result, History, Iterations, LastChange
view = Inspector(Value=end.Result, History=end.History, Spacing=4)  # -> Value, Geometry
count = Panel(end.Iterations)
