# Grasshopper definition loops-stop-condition.gh (Grasshopper 1.0.8)
# plug-ins: Swalloop

# about: Demo: stop condition (Newton until close)
# 
# Stops when a Condition built from Math and Compare becomes true, read from the current state.
x0 = Slider(1, range=0.1..10)
a = Slider(2, range=0.5..50)
start = LoopStart(Initial=x0)  # -> State, Index, Item
step = NewtonStep(X=start.State, SqrtOf=a)
sq = Math(Op="×", A=start.State, B=start.State)
err = Math(Op="|a-b|", A=sq, B=a)
close = Compare(Test="<", A=err, B=1e-09)
end = LoopEnd(Result=step, Condition=close, Kind="Repeat", Iterations=50, Tolerance=0)  # -> Result, History, Iterations, LastChange
view = Inspector(Value=end.Result, History=end.History, Spacing=4)  # -> Value, Geometry
count = Panel(end.Iterations)
