# Grasshopper definition loops-while.gh (Grasshopper 1.0.8)
# plug-ins: Swalloop

# about: Demo: While (double until 1000)
# 
# A While loop: keeps doubling while the Condition holds.
x0 = Slider(1, range=1..10)
start = LoopStart(Initial=x0)  # -> State, Index, Item
dbl = Math(Op="×", A=start.State, B=2)
small = Compare(Test="<", A=start.State, B=1000)
end = LoopEnd(Result=dbl, Condition=small, Kind="While", Iterations=100, Tolerance=0)  # -> Result, History, Iterations, LastChange
view = Inspector(Value=end.Result, History=end.History, Spacing=4)  # -> Value, Geometry
count = Panel(end.Iterations)
