# Grasshopper definition skyscraper-manhattan.gh (Grasshopper 1.0.8)
# plug-ins: Swalloop

# about: Manhattan block
# 
# One tower in a dense Manhattan-like block. Wind, Orient and Structure sit inside a single loop; the loop reshapes every floor until it settles.
ctx = Context(Style="Manhattan", Blocks=3, HeightScale=1, Seed=7)
tower = Tower(Floors=60, FloorHeight=4, Width=36, Depth=36, TwistDeg=0, Roundness=0.2, Source="Initial")
start = LoopStart(Initial=tower)  # -> State, Index, Item
wind = Wind(Tower=start.State, Context=ctx, Speed10mMS=40, FromDeg=300, TerrainExp=0.25)
stream = Orient(
    Tower=wind,
    Rate=0.2,
    Aspect=1.8,
    MaxRoundness=0.8,
    SunWeight=0.7,
    SunAzimuth=150,
    MinWidthM=0,
    MinDepthM=0,
    MinCornerRadiusM=0,
    MaxRotationPassDeg=90,
    MaxTwistFromBaseDeg=0,
    FloorToFloorSmoothing=0,
    Search="Grid")
struct = Structure(Tower=stream, AllowableMPa=6, FloorLoadKNM2=10, StructuralShare=0.08, Relaxation=0.3, MinPlateM=20, MaxPlateM=60)
end = LoopEnd(Result=struct, Kind="Repeat", Iterations=150, Tolerance=0)  # -> Result, History, Iterations, LastChange
sun = Sun(Tower=end.Result, Context=ctx, AzimuthDeg=150, AltitudeDeg=35)
metrics = Metrics(Tower=end.Result)  # -> FloorAreaM2, StructureM3, BaseMomentMNm, MaxUtilisation
view = Viewer(
    Tower=sun,
    Context=ctx,
    History=end.History,
    ColourBy="Utilisation",
    Colormap="Turbo",
    Range="Auto",
    Min=0,
    Max=1,
    Reverse="No")  # -> Tower, Floors, Context
r1 = Panel(metrics.FloorAreaM2)
r3 = Panel(metrics.BaseMomentMNm)
r2 = Panel(metrics.StructureM3)
r4 = Panel(metrics.MaxUtilisation)
